# Grasshopper definition CFB_geometryGeneration.gh (Grasshopper 1.0.7)
# plug-ins: Anemone

startid = Panel("0")
# This component defines the path to csv file (where to find the bridge parameter samples)
endid = Panel("14")
# Read and Loop
# Step 4: Double click on Loop start.
# 
# Check that no components in the GH file are red (error).
# 
# And then connect r with Repeat.
# 
# This will start the loop.
panel = Panel("0")

# ----
# Plate Parametrisation
l_mm = Slider(13200, range=3500..16000)
b_sec2_b1 = Slider(0.2, range=0.1..0.5)
h_fp_mm = Slider(300, range=100..1700)
b1_mm = Slider(12000, range=7000..35000.001)
b_sec1_b1 = Slider(0.3, range=0.1..0.4)
l_sec = Slider(0.35, range=0.1..0.5)

# ----
# These are the parameter sliders. As we read the parameters from a csv we don't need these anymore.
# 
# If necessary they can be connected to the parameter group.
mesh_size_factor_t = Slider(3, range=0.3..3)

# ----
# Wall Parametrisation
h_s7_9 = Slider(0.25, range=0..0.5)
h_w_el_mm = Slider(2500, range=2000..5000)
h_s1_3 = Slider(0.2, range=0..0.5)
t_w_mm = Slider(200, range=100..1700)

# ----
# Step 1: Check that your command line in the rhino tab is empty.
# 
# Often you have to exit the "Grasshopper option" command in the rhino tab by clicking on the rhino tab and pressing Esc.
# Read
idx_s_batchnumber = Panel("317")
ghpython_script = GhPythonScript(idx_s=idx_s_batchnumber, StartID=startid, EndID=endid)  # -> out, r, csv_file_path, batch_folder_path; inputs idx_s: Int32
# ---------- ghpython_script: Python ----------
"""Constructs path to csv file for defined sample index and calcs. number of bridges.
    Inputs:
        idx_s: Sample index
        StartID: The ID of the first bridge that should be generated.
        EndID: The ID of the last bridge that should be generated.
        
    Output:
        r: Number of IDs to iterate through.
        csv_file_path: Path to csv file of defined sampling index.
        batch_folder_path: Path to batch folder of defined sampling index.
        
        """

__author__ = "kuhnso"
__version__ = "2023.07.26"

import os


# Construct Path to csv file of the defined sample index (idx_s)
current_directory = os.getcwd()
folder_name='CFBData'
folder_path = os.path.join(current_directory, folder_name)
batch_folder_path=folder_path + '\\{}_Batch'.format(idx_s)
csv_file_path = batch_folder_path + '\\{}_CFBSamples.csv'.format(idx_s)



# Calculate number of IDs 
r=EndID-StartID
# ---------- end ghpython_script ----------
# This component defines the path to csv file (where to find the bridge parameter samples)
path = Text(ghpython_script.csv_file_path)

# ----
# Step 2: Input idx_s (sample batch number),
# StartID and EndID
# Step 3: Check Path is correct.
panel_2 = Panel(ghpython_script.csv_file_path)

# ----
# Loop
panel_3 = Panel(ghpython_script.r)
r = Integer(panel_3)
# Double Click on Loop Start!
loop_start = LoopStart(Repeat=panel)  # -> port, Counter, Data
# Step 5:: After Generation is finished connect 0 with Repeat. (This makes sure on restart of the file it does not run all bridges of your selected sample index)
live = Panel(loop_start.Counter)

ghpython_script_2 = GhPythonScript(ID=loop_start.Counter, csv_file_path=path, idx_s=idx_s_batchnumber)  # -> out, idx_s, r, ids, L, b1, b_sec1_b1, b_sec2_b1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
# ---------- ghpython_script_2: Python ----------
"""This script reads out all samples saved in the csv file of the defined sampling iteration.
    It saves whole scv file in a dict. And then saves the parameter values of current ID 
    in parameter variables.
    Inputs:
        ID: ID of the bridge sample.
        csv_file_path: Path to the csv file 
    Output:
        ..: Parametervariables.
    TODOS: Inefficient to read out whole dict for every iteration again. More efficient read out only values of curren ID """

__author__ = "kuhnso"
__version__ = "2023.07.20"

import rhinoscriptsyntax as rs
import csv


def read_csv_to_dict(csv_file_path):
    result_dict = {}
    with open(csv_file_path, 'r') as csvfile:
        csvreader = csv.reader(csvfile)
        header = next(csvreader)  # Read the first row as the header

        # Initialize the dictionary with empty lists for each column
        for column_name in header:
            result_dict[column_name] = []

        # Read the remaining rows and append values to respective columns
        for row in csvreader:
            for i, value in enumerate(row):
                result_dict[header[i]].append(value)

    return result_dict
    
    


# Read corresponding csv files and save to a dict
data_dict = read_csv_to_dict(csv_file_path)



# Read out parameters for current iteration counter (ID=counter)
r=len(data_dict[""])-1

ids = int(data_dict[""][ID])

L = float(data_dict["L"][ID])
b1 = float(data_dict["b1"][ID])

b_sec1_b1 = float(data_dict["b_sec1_b1"][ID])
b_sec2_b1 = float(data_dict["b_sec2_b1"][ID])

l_sec = float(data_dict["l_sec"][ID])
t_p = float(data_dict["t_p"][ID])


t_w = float(data_dict["t_w"][ID])
h_w = float(data_dict["h_w"][ID])
h_S1_3 = float(data_dict["h_S1_3"][ID])
h_S7_9 = float(data_dict["h_S7_9"][ID])


mesh_size_factor = float(data_dict["mesh_size_factor"][ID])
# ---------- end ghpython_script_2 ----------
idx_s = Integer(ghpython_script_2.idx_s)

# ----
# This component deletes everything:
# - All objects
# - all layers (except default)
# - all user text keys
# in the rhino file
# (so nothing should be generated or saved to the user text before this component is run)
# In this component we check for unreasonable parameter combinations
# --> GeoError UserText key is set
delete_save_ut_error = GhPythonScript(
    delete_all=Toggle(True),
    id=ghpython_script_2.ids,
    idx_s=idx_s,
    L=ghpython_script_2.L,
    b1=ghpython_script_2.b1,
    b_sec1_b1=ghpython_script_2.b_sec1_b1,
    b_sec2_b1=ghpython_script_2.b_sec2_b1,
    l_sec=ghpython_script_2.l_sec,
    t_p=ghpython_script_2.t_p,
    t_w=ghpython_script_2.t_w,
    h_w=ghpython_script_2.h_w,
    h_S1_3=ghpython_script_2.h_S1_3,
    h_S7_9=ghpython_script_2.h_S7_9,
    mesh_size_factor=ghpython_script_2.mesh_size_factor)  # -> out, idx
# ---------- delete_save_ut_error: Python ----------
__author__ = "kuhnso"
__version__ = "2023.07.26"

import rhinoscriptsyntax as rs
import Rhino as r
import scriptcontext as sc

# Set active doc to the currently open Rhino file
sc.doc = r.RhinoDoc.ActiveDoc

#--------------Delete All ----------------------

#After the geometry is saved, it is deleted again for the next iteration
if delete_all:
    
    # Set active doc to the currently open Rhino file
    sc.doc = r.RhinoDoc.ActiveDoc
    
#    #Creat an empty temp layer
#    sc.doc.Layers.Add("Temp", col.Black)
#    temp_layer= sc.doc.Layers.FindByFullPath("Temp", 0)
#    sc.doc.Layers.SetCurrentLayerIndex(temp_layer, False)
    
    # Delete all elements, meshes from previous iterations
    # (does not delete the layers, just the geometry objects)
    # does not delete the geo in the active layer?
    rs.Command("_SelAll", True)
    rs.Command("_Delete",True)
    
    #delete all layers (except Default wich is set to the active layer)
    #set default layer to active layer
    Default= sc.doc.Layers.FindByFullPath("Default", 0)
    sc.doc.Layers.SetCurrentLayerIndex(Default, False)
    #LayerPurge() delets all layers no matter if they are filled with objects
    layerNames=rs.LayerNames()
    for layer in layerNames:
        rs.PurgeLayer(layer)
        
        
    ## Clear rhino user text (all keys that we dont need)
    if rs.GetDocumentUserText()== None:
        print("Document User Text of id_{} is already empty. No keys exist.".format(id))
    else:
        for key in rs.GetDocumentUserText():
            rs.SetDocumentUserText(key,"") #To deleate the key it is addigned an empty value! then this key doesn show up anymore
            print("All keys of DocumentUserText (of id_{}) were deleated.".format(id))
                     


#--------------Save Paras to DocUserText ----------------------

# iterate through all parameters and save them in the UserText in the
# rhino file. 

para_values=[id, idx_s,
            L,b1,
            b_sec1_b1,b_sec2_b1,
            t_p,
            t_w,h_w,h_S1_3,h_S7_9,
            mesh_size_factor]
             
para_names=['id', 'idx_s',
            'L','b1',
            'b_sec1_b1','b_sec2_b1',
            't_p',
            't_w','h_w','h_S1_3','h_S7_9',
            'mesh_size_factor']


for name, value in zip(para_names,para_values):
    print(name)
    print(value)
    rs.SetDocumentUserText(name,str(value))
    
    
    
##--------------------- Error Messages -------------------

#Initialise counter
geomError_count=0


rs.SetDocumentUserText("GomError",str(geomError_count))



#------Communication to next component ------
idx=id
# ---------- end delete_save_ut_error ----------

mesh_size_factor = Number(ghpython_script_2.mesh_size_factor)
t_w = Number(ghpython_script_2.t_w)
h_w = Number(ghpython_script_2.h_w)
h_s1_3_2 = Number(ghpython_script_2.h_S1_3)
h_s7_9_2 = Number(ghpython_script_2.h_S7_9)
b_sec1_b1_2 = Number(ghpython_script_2.b_sec1_b1)
t_p = Number(ghpython_script_2.t_p)
b_sec2_b1_2 = Number(ghpython_script_2.b_sec2_b1)
l_sec_2 = Number(ghpython_script_2.l_sec)
# Parameter
L = Number(ghpython_script_2.L)
b1 = Number(ghpython_script_2.b1)

# ----
# Surface geometry generation
origin = ConstructPoint(XCoordinate=0, YCoordinate=0, ZCoordinate=0)
ghpython_script_3 = GhPythonScript(
    ID=delete_save_ut_error.idx,
    origin=origin,
    b1=b1,
    L=L,
    b_sec1_b1=b_sec1_b1_2,
    b_sec2_b1=b_sec2_b1_2,
    l_sec=l_sec_2,
    h_FP=t_p,
    t_w=t_w,
    h_w_el=h_w,
    h_S1_3=h_s1_3_2,
    h_S7_9=h_s7_9_2,
    mesh_size_factor=mesh_size_factor)  # -> out, L_el, point1, point2, point3, point4, point10, point11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; inputs origin: Point3d
# ---------- ghpython_script_3: Python ----------
"""Scripting component to generate the deck slab geometry.
    Inputs:
        x: The x script variable
        y: The y script variable
    Output:
        a: The a output variable"""

__author__ = "kuhnso"
__version__ = "2023.10.30"

import rhinoscriptsyntax as rs
import math as m

#####################
#initialization
####################

point1=origin

L_el=L-t_w
t_min=min(t_w,h_FP)



##############################################
# Generate deck slab edge points
##############################################

#get coordinates of point 1 
point1=rs.AddPoint(str(origin))
c1=rs.PointCoordinates(point1, point=None)

#calc. coordinates of point 2
point2=rs.AddPoint((c1[0],c1[1]+L_el,c1[2]))

#calc. coordinates of point 3
point3=rs.AddPoint((c1[0]+b1,c1[1]+L_el,c1[2]))

#calc. coordinates of point 4
point4=rs.AddPoint((c1[0]+b1,c1[1],c1[2]))



#ConstructPlateEdges
edge1=rs.AddLine(point1, point2)
edge2=rs.AddLine(point2, point3)
edge3=rs.AddLine(point3, point4)
edge4=rs.AddLine(point4, point1)


##############################################
# parametrization of deck slab sections
##############################################
L_outer=L_el*l_sec
L_inner=L_el - 2*L_outer

######Get intermediate porints on plate edges
# get intermediate points on edge 1 (span)
point10 = rs.AddPoint((c1[0],c1[1]+L_outer,c1[2]))
point11 = rs.AddPoint((c1[0],c1[1]+L_outer+L_inner,c1[2]))


#get intermediate points on edge 2
point12 = rs.AddPoint((c1[0]+b_sec1_b1*b1, c1[1]+L_el,c1[2]))
point13 = rs.AddPoint((c1[0]+b_sec1_b1*b1+b_sec2_b1*b1,c1[1]+L_el,c1[2]))

# get intermediate points on edge 3 (span)
point14 = rs.AddPoint((c1[0]+b1,c1[1]+L_outer+L_inner,c1[2]))
point15 = rs.AddPoint((c1[0]+b1,c1[1]+L_outer,c1[2]))

#get intermediate points on edge 4 
point16 = rs.AddPoint((c1[0]+b_sec1_b1*b1+b_sec2_b1*b1, c1[1], c1[2]))
point17 = rs.AddPoint((c1[0]+b_sec1_b1*b1, c1[1], c1[2]))



######Get intermediate points in plate middle
# get points from calculated angle
point21 = rs.AddPoint((c1[0]+b_sec1_b1*b1, c1[1]+L_outer, c1[2]))
point22 = rs.AddPoint((c1[0]+b_sec1_b1*b1, c1[1]+L_outer+L_inner, c1[2]))

point23 = rs.AddPoint((c1[0]+b_sec1_b1*b1+b_sec2_b1*b1, c1[1]+L_outer+L_inner, c1[2]))
point24 = rs.AddPoint((c1[0]+b_sec1_b1*b1+b_sec2_b1*b1, c1[1]+L_outer, c1[2]))


########################################
# generate surface elements for different sections
#########################################

# initialize section quad list
quad_list_1=[]
quad_list_2=[]
quad_list_3=[]
quad_list_4=[]
quad_list_5=[]
quad_list_6=[]
quad_list_7=[]
quad_list_8=[]
quad_list_9=[]


# define slab plate quads
quad_1=rs.AddSrfPt([point1,point10,point21,point17])
quad_2=rs.AddSrfPt([point17,point21,point24,point16])
quad_3=rs.AddSrfPt([point16,point24,point15,point4])

quad_4=rs.AddSrfPt([point11,point2,point12,point22])
quad_5=rs.AddSrfPt([point22,point12,point13,point23])
quad_6=rs.AddSrfPt([point23,point13,point3,point14])

quad_7=rs.AddSrfPt([point10,point11,point22,point21])
quad_8=rs.AddSrfPt([point21,point22,point23,point24])
quad_9=rs.AddSrfPt([point24,point23,point14,point15])

#return quads in a list
plate_quads=[quad_1,quad_2,quad_3, quad_4, quad_5, 
            quad_6, quad_7,quad_8, quad_9]



#####################
#calculate mesh counts
####################
#### calculate mesh counts - u
p1=int(m.ceil(L_outer/(t_min*mesh_size_factor))) 
p3=int(m.ceil(L_inner/(t_min*mesh_size_factor))) 

####calculate mesh counts - v
b_sec1= b_sec1_b1*b1 
b_sec2= b_sec2_b1*b1
b_sec3= b1-b_sec1-b_sec2

m1=int(m.ceil(b_sec1/(t_min*mesh_size_factor)))
m2=int(m.ceil(b_sec2/(t_min*mesh_size_factor)))
m3=int(m.ceil(b_sec3/(t_min*mesh_size_factor)))


#return counts in a list
mesh_counts_plate=[m1,m2,m3,p1,p3]
# ---------- end ghpython_script_3 ----------
# This component group generates the deck slab and wall geometries (surfaces) and calculates their mesh counts for the defined mesh size factor.
wall1_generation_withrigidlinks = GhPythonScript(
    point1=ghpython_script_3.point1,
    point4=ghpython_script_3.point4,
    point16=ghpython_script_3.point16,
    point17=ghpython_script_3.point17,
    L_el=ghpython_script_3.L_el,
    h_w_el=h_w,
    h_FP=t_p,
    h_S1_3=h_s1_3_2,
    h_S7_9=h_s7_9_2,
    t_w=t_w,
    mesh_size_factor=mesh_size_factor)  # -> out, point1o, point4o, point5, point6, port, point50, point51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
# ---------- wall1_generation_withrigidlinks: Python ----------
__author__ = "kuhnso"
__version__ = "2022.11.16"

import rhinoscriptsyntax as rs
import math as m


##########################
#Initialize
#########################
point1=rs.AddPoint(str(point1))
c1=rs.PointCoordinates(point1, point=None)
point4=rs.AddPoint(str(point4))
c4=rs.PointCoordinates(point4, point=None)
    
#rigid link hight -> offset points
rlink_h= h_FP

        
point1o=rs.AddPoint((c1[0],c1[1],c1[2]-rlink_h))
c1o=rs.PointCoordinates(point1o, point=None)
point4o=rs.AddPoint((c4[0],c4[1],c4[2]-rlink_h))
c4o=rs.PointCoordinates(point4o, point=None)
    
    
    
##########################
#generate Wall1
##########################
    
###corner points
point5=rs.AddPoint((c1o[0],c1o[1],c1o[2]-h_w_el))
point6=rs.AddPoint((c4o[0],c4o[1],c4o[2]-h_w_el))
    

###edge points
h_o=h_S1_3*h_w_el
h_u=h_S7_9*h_w_el
    
point51=rs.AddPoint((c1o[0],c1o[1],c1o[2]-h_o))
c5=rs.PointCoordinates(point5, point=None)
point50=rs.AddPoint((c5[0],c5[1],c5[2]+h_u))
point52=rs.AddPoint((c4o[0],c4o[1],c4o[2]-h_o))
c6=rs.PointCoordinates(point6, point=None)
point53=rs.AddPoint((c6[0],c6[1],c6[2]+h_u))


#point17o
point17=rs.AddPoint(str(point17))
c17=rs.PointCoordinates(point17, point=None)
point17o=rs.AddPoint((c17[0],c17[1],c17[2]-rlink_h))
c17o=rs.PointCoordinates(point17o, point=None)
#point16o
point16=rs.AddPoint(str(point16))
c16=rs.PointCoordinates(point16, point=None)
point16o=rs.AddPoint((c16[0],c16[1],c16[2]-rlink_h))
c16o=rs.PointCoordinates(point16o, point=None)

    

point54=rs.AddPoint((c16o[0],c16o[1],c16o[2]-h_w_el))
c54=rs.PointCoordinates(point54, point=None)
point55=rs.AddPoint((c17o[0],c17o[1],c17o[2]-h_w_el))
c55=rs.PointCoordinates(point55, point=None)

# intermediate points
point57=rs.AddPoint((c17o[0],c17o[1],c17o[2]-h_o))
point56=rs.AddPoint((c55[0],c55[1],c55[2]+h_u))

point58=rs.AddPoint((c16o[0],c16o[1],c16o[2]-h_o))
point59=rs.AddPoint((c54[0],c54[1],c54[2]+h_u))
 

##############################################
# generate Quad elements (wall1)
##############################################
quad_w1_1=rs.AddSrfPt([point51,point1o,point17o,point57])
quad_w1_2=rs.AddSrfPt([point57,point17o,point16o,point58])
quad_w1_3=rs.AddSrfPt([point58,point16o,point4o,point52])

quad_w1_4=rs.AddSrfPt([point50,point51,point57,point56])
quad_w1_5=rs.AddSrfPt([point56,point57,point58,point59])
quad_w1_6=rs.AddSrfPt([point59,point58,point52,point53])

quad_w1_7=rs.AddSrfPt([point5,point50,point56,point55])
quad_w1_8=rs.AddSrfPt([point55,point56,point59,point54])
quad_w1_9=rs.AddSrfPt([point54,point59,point53,point6])

#return as list
wall_1_quads=[quad_w1_1, quad_w1_2, quad_w1_3, quad_w1_4, quad_w1_5, 
                quad_w1_6, quad_w1_7, quad_w1_8, quad_w1_9]



#####################
#calculate mesh counts
####################

h_1_3=h_o
h_4_6=h_w_el-h_o-h_u
h_7_9=h_u

t_min=min(t_w,h_FP)
w1=int(m.ceil(h_o / (t_min*mesh_size_factor)))
w2=int(m.ceil(h_4_6/ (t_min*mesh_size_factor)))
w3=int(m.ceil(h_u / (t_min*mesh_size_factor)))
mesh_counts_walls=[w1,w2,w3]




##########################
#generate Wall2 - copy and move from wall1
##########################

#translation__vec=(0,L_el,0)
#quad_w2_1=rs.CopyObject(quad_w1_1,translation__vec)
#quad_w2_2=rs.CopyObject(quad_w1_2,translation__vec)
#quad_w2_3=rs.CopyObject(quad_w1_3,translation__vec)
#
#quad_w2_4=rs.CopyObject(quad_w1_4,translation__vec)
#quad_w2_5=rs.CopyObject(quad_w1_5,translation__vec)
#quad_w2_6=rs.CopyObject(quad_w1_6,translation__vec)
#
#quad_w2_7=rs.CopyObject(quad_w1_7,translation__vec)
#quad_w2_8=rs.CopyObject(quad_w1_8,translation__vec)
#quad_w2_9=rs.CopyObject(quad_w1_9,translation__vec)
# ---------- end wall1_generation_withrigidlinks ----------

# ----
# This component group meshes the deck slab surface elements.
ghpython_script_4 = GhPythonScript(mesh_counts_plate=ghpython_script_3.mesh_counts_plate)  # -> m1, m2, m3, p1, p3; inputs mesh_counts_plate: list
# ---------- ghpython_script_4: Python ----------
__author__ = "kuhnso"
__version__ = "2023.11.02"

import rhinoscriptsyntax as rs

m1=mesh_counts_plate[0]
m2=mesh_counts_plate[1]
m3=mesh_counts_plate[2]
m3=mesh_counts_plate[2]
p1=mesh_counts_plate[3]
p3=mesh_counts_plate[4]
# ---------- end ghpython_script_4 ----------
p1 = Number(ghpython_script_4.p1)
p3 = Number(ghpython_script_4.p3)
ghpython_script_5 = GhPythonScript(plate_quads=ghpython_script_3.plate_quads)  # -> plate_1, plate_2, plate_3, plate_4, plate_5, plate_6, plate_7, plate_8, plate_9; inputs plate_quads: list
# ---------- ghpython_script_5: Python ----------
__author__ = "kuhnso"
__version__ = "2023.11.02"

import rhinoscriptsyntax as rs


plate_1=plate_quads[0]
plate_2=plate_quads[1]
plate_3=plate_quads[2]
plate_4=plate_quads[3]
plate_5=plate_quads[4]
plate_6=plate_quads[5]
plate_7=plate_quads[6]
plate_8=plate_quads[7]
plate_9=plate_quads[8]
# ---------- end ghpython_script_5 ----------
plate_2 = Geometry(ghpython_script_5.plate_2)
# deck slab meshing
plate_1 = Geometry(ghpython_script_5.plate_1)
plate_3 = Geometry(ghpython_script_5.plate_3)
plate_5 = Geometry(ghpython_script_5.plate_5)
plate_8 = Geometry(ghpython_script_5.plate_8)
plate_4 = Geometry(ghpython_script_5.plate_4)
plate_6 = Geometry(ghpython_script_5.plate_6)
plate_9 = Geometry(ghpython_script_5.plate_9)
plate_7 = Geometry(ghpython_script_5.plate_7)
mesh_surface = MeshSurface(Surface=plate_9, UCount=p3, VCount=ghpython_script_4.m3, Overhang=True, Equalize=False)
mesh_surface_2 = MeshSurface(Surface=[plate_3, plate_6], UCount=p1, VCount=ghpython_script_4.m3, Overhang=True, Equalize=False)
mesh_surface_3 = MeshSurface(Surface=plate_8, UCount=p3, VCount=ghpython_script_4.m2, Overhang=True, Equalize=False)
mesh_surface_4 = MeshSurface(Surface=plate_7, UCount=p3, VCount=ghpython_script_4.m1, Overhang=True, Equalize=False)
mesh_surface_5 = MeshSurface(Surface=[plate_2, plate_5], UCount=p1, VCount=ghpython_script_4.m2, Overhang=True, Equalize=False)
mesh_surface_6 = MeshSurface(Surface=[plate_1, plate_4], UCount=p1, VCount=ghpython_script_4.m1, Overhang=True, Equalize=False)
flip_mesh = FlipMesh(Mesh=mesh_surface_3, VertexNormals=True, FaceNormals=True, FaceOrientation=True)
flip_mesh_2 = FlipMesh(Mesh=mesh_surface, VertexNormals=True, FaceNormals=True, FaceOrientation=True)
flip_mesh_3 = FlipMesh(Mesh=mesh_surface_2, VertexNormals=True, FaceNormals=True, FaceOrientation=True)
flip_mesh_4 = FlipMesh(Mesh=mesh_surface_4, VertexNormals=True, FaceNormals=True, FaceOrientation=True)
flip_mesh_5 = FlipMesh(Mesh=mesh_surface_5, VertexNormals=True, FaceNormals=True, FaceOrientation=True)
flip_mesh_6 = FlipMesh(Mesh=mesh_surface_6, VertexNormals=True, FaceNormals=True, FaceOrientation=True)
merge = Merge(Data1=flip_mesh_6, Data2=flip_mesh_5, Data3=flip_mesh_3, Data4=flip_mesh_4, Data5=flip_mesh, Data6=flip_mesh_2)
plate = Geometry(merge)

# ----
# Mesh Wall 1
# wall 2 has to be generated from the not fliped meshes to be in the correct direction (local coordinate system)
ghpython_script_6 = GhPythonScript(
    mesh_counts_plate=ghpython_script_3.mesh_counts_plate,
    mesh_counts_walls=wall1_generation_withrigidlinks.mesh_counts_walls)  # -> m1, m2, m3, p1, p3, w1, w2, w3; inputs mesh_counts_plate: list, mesh_counts_walls: list
# ---------- ghpython_script_6: Python ----------
__author__ = "kuhnso"
__version__ = "2023.11.02"

import rhinoscriptsyntax as rs

m1=mesh_counts_plate[0]
m2=mesh_counts_plate[1]
m3=mesh_counts_plate[2]
p1=mesh_counts_plate[3]
p3=mesh_counts_plate[4]


w1=mesh_counts_walls[0]
w2=mesh_counts_walls[1]
w3=mesh_counts_walls[2]
# ---------- end ghpython_script_6 ----------
# This component group meshes the wall surface elements.
ghpython_script_7 = GhPythonScript(wall_1_quads=wall1_generation_withrigidlinks.wall_1_quads)  # -> wall_1, wall_2, wall_3, wall_4, wall_5, wall_6, wall_7, wall_8, wall_9; inputs wall_1_quads: list
# ---------- ghpython_script_7: Python ----------
__author__ = "kuhnso"
__version__ = "2023.11.02"

import rhinoscriptsyntax as rs


wall_1=wall_1_quads[0]
wall_2=wall_1_quads[1]
wall_3=wall_1_quads[2]
wall_4=wall_1_quads[3]
wall_5=wall_1_quads[4]
wall_6=wall_1_quads[5]
wall_7=wall_1_quads[6]
wall_8=wall_1_quads[7]
wall_9=wall_1_quads[8]
# ---------- end ghpython_script_7 ----------
w2 = Number(ghpython_script_6.w2)
w1 = Number(ghpython_script_6.w1)
w3 = Number(ghpython_script_6.w3)
wall_1_2 = Geometry(ghpython_script_7.wall_2)
wall_1_4 = Geometry(ghpython_script_7.wall_4)
wall_1_5 = Geometry(ghpython_script_7.wall_5)
wall_1_7 = Geometry(ghpython_script_7.wall_7)
wall_1_1 = Geometry(ghpython_script_7.wall_1)
wall_1_6 = Geometry(ghpython_script_7.wall_6)
wall_1_8 = Geometry(ghpython_script_7.wall_8)
wall_1_9 = Geometry(ghpython_script_7.wall_9)
wall_1_3 = Geometry(ghpython_script_7.wall_3)
mesh_surface_7 = MeshSurface(Surface=wall_1_1, UCount=w1, VCount=ghpython_script_6.m1, Overhang=True, Equalize=False)
mesh_surface_8 = MeshSurface(Surface=wall_1_2, UCount=w1, VCount=ghpython_script_6.m2, Overhang=True, Equalize=False)
mesh_surface_9 = MeshSurface(Surface=wall_1_3, UCount=w1, VCount=ghpython_script_6.m3, Overhang=True, Equalize=False)
mesh_surface_10 = MeshSurface(Surface=wall_1_4, UCount=w2, VCount=ghpython_script_6.m1, Overhang=True, Equalize=False)
mesh_surface_11 = MeshSurface(Surface=wall_1_5, UCount=w2, VCount=ghpython_script_6.m2, Overhang=True, Equalize=False)
mesh_surface_12 = MeshSurface(Surface=wall_1_6, UCount=w2, VCount=ghpython_script_6.m3, Overhang=True, Equalize=False)
mesh_surface_13 = MeshSurface(Surface=wall_1_7, UCount=w3, VCount=ghpython_script_6.m1, Overhang=True, Equalize=False)
mesh_surface_14 = MeshSurface(Surface=wall_1_8, UCount=w3, VCount=ghpython_script_6.m2, Overhang=True, Equalize=False)
mesh_surface_15 = MeshSurface(Surface=wall_1_9, UCount=w3, VCount=ghpython_script_6.m3, Overhang=True, Equalize=False)
flip_mesh_7 = FlipMesh(Mesh=mesh_surface_8, VertexNormals=True, FaceNormals=True, FaceOrientation=True)
flip_mesh_8 = FlipMesh(Mesh=mesh_surface_9, VertexNormals=True, FaceNormals=True, FaceOrientation=True)
flip_mesh_9 = FlipMesh(Mesh=mesh_surface_10, VertexNormals=True, FaceNormals=True, FaceOrientation=True)
flip_mesh_10 = FlipMesh(Mesh=mesh_surface_11, VertexNormals=True, FaceNormals=True, FaceOrientation=True)
flip_mesh_11 = FlipMesh(Mesh=mesh_surface_12, VertexNormals=True, FaceNormals=True, FaceOrientation=True)
flip_mesh_12 = FlipMesh(Mesh=mesh_surface_13, VertexNormals=True, FaceNormals=True, FaceOrientation=True)
flip_mesh_13 = FlipMesh(Mesh=mesh_surface_14, VertexNormals=True, FaceNormals=True, FaceOrientation=True)
flip_mesh_14 = FlipMesh(Mesh=mesh_surface_15, VertexNormals=True, FaceNormals=True, FaceOrientation=True)
flip_mesh_15 = FlipMesh(Mesh=mesh_surface_7, VertexNormals=True, FaceNormals=True, FaceOrientation=True)
wall_1 = Merge(
    Data1=flip_mesh_15,
    Data2=flip_mesh_7,
    Data3=flip_mesh_8,
    Data4=flip_mesh_9,
    Data5=flip_mesh_10,
    Data6=flip_mesh_11,
    Data7=flip_mesh_12,
    Data8=flip_mesh_13,
    Data9=flip_mesh_14)
wall_2 = Merge(
    Data1=mesh_surface_7,
    Data2=mesh_surface_8,
    Data3=mesh_surface_9,
    Data4=mesh_surface_10,
    Data5=mesh_surface_11,
    Data6=mesh_surface_12,
    Data7=mesh_surface_13,
    Data8=mesh_surface_14,
    Data9=mesh_surface_15)
wall_1_10 = Geometry(wall_1)
vector_xyz = VectorXYZ(XComponent=0, YComponent=ghpython_script_3.L_el, ZComponent=0)  # -> Vector, Length
move = Move(Geometry=wall_2, Motion=vector_xyz.Vector)  # -> Geometry, Transform
wall_2_2 = Geometry(move.Geometry)

# ----
# MPCs Points Extraction
# From Wall elements
# Wall1
# Wall2
# Connect MPC elements
# From Plate elements
# Side of Wall1
# Side of Wall2
# TODO:
# Vllt kann man diese ganzen einzelnen python components zusammenfassen
# 
# problem ist die meshing funktion, wenn ich diese als python fuktion finden würde dann wäre es viel überscihtlicher!
ghpython_script_8 = GhPythonScript(
    mesh_counts_plate=ghpython_script_3.mesh_counts_plate,
    mesh_counts_walls=wall1_generation_withrigidlinks.mesh_counts_walls)  # -> m1, m2, m3, p1, p3, w1, w2, w3; inputs mesh_counts_plate: list, mesh_counts_walls: list; same code as ghpython_script_6
ghpython_script_9 = GhPythonScript(plate=plate)  # -> out, plate_1, plate_2, plate_3, plate_4, plate_5, plate_6, plate_7, plate_8, plate_9; inputs plate: list
# ---------- ghpython_script_9: Python ----------
__author__ = "kuhnso"
__version__ = "2023.11.02"

import rhinoscriptsyntax as rs



plate_1=plate[0]
plate_4=plate[1]
plate_2=plate[2]
plate_5=plate[3]
plate_3=plate[4]
plate_6=plate[5]

plate_7=plate[6]
plate_8=plate[7]
plate_9=plate[8]
# ---------- end ghpython_script_9 ----------
ghpython_script_10 = GhPythonScript(
    mesh_counts_plate=ghpython_script_3.mesh_counts_plate,
    mesh_counts_walls=wall1_generation_withrigidlinks.mesh_counts_walls)  # -> m1, m2, m3, p1, p3, w1, w2, w3; inputs mesh_counts_plate: list, mesh_counts_walls: list; same code as ghpython_script_6
ghpython_script_11 = GhPythonScript(wall_1_meshes=wall_1_10)  # -> wall_1, wall_2, wall_3, wall_4, wall_5, wall_6, wall_7, wall_8, wall_9; inputs wall_1_meshes: list
# ---------- ghpython_script_11: Python ----------
__author__ = "kuhnso"
__version__ = "2023.11.02"

import rhinoscriptsyntax as rs


wall_1=wall_1_meshes[0]
wall_2=wall_1_meshes[1]
wall_3=wall_1_meshes[2]
wall_4=wall_1_meshes[3]
wall_5=wall_1_meshes[4]
wall_6=wall_1_meshes[5]
wall_7=wall_1_meshes[6]
wall_8=wall_1_meshes[7]
wall_9=wall_1_meshes[8]
# ---------- end ghpython_script_11 ----------
plate_3_2 = Geometry(ghpython_script_9.plate_3)
plate_1_2 = Geometry(ghpython_script_9.plate_1)
plate_2_2 = Geometry(ghpython_script_9.plate_2)
wall_1_1_2 = Geometry(ghpython_script_11.wall_1)
deconstruct_mesh = DeconstructMesh(Mesh=plate_2_2)  # -> flatten(Vertices), Faces, Colours, Normals
deconstruct_mesh_2 = DeconstructMesh(Mesh=plate_3_2)  # -> flatten(Vertices), Faces, Colours, Normals
deconstruct_mesh_3 = DeconstructMesh(Mesh=plate_1_2)  # -> flatten(Vertices), Faces, Colours, Normals
wall_1_2_2 = Geometry(ghpython_script_11.wall_2)
wall_1_3_2 = Geometry(ghpython_script_11.wall_3)
deconstruct_mesh_4 = DeconstructMesh(Mesh=wall_1_1_2)  # -> flatten(Vertices), Faces, Colours, Normals
deconstruct_mesh_5 = DeconstructMesh(Mesh=wall_1_2_2)  # -> flatten(Vertices), Faces, Colours, Normals
deconstruct_mesh_6 = DeconstructMesh(Mesh=wall_1_3_2)  # -> flatten(Vertices), Faces, Colours, Normals
ghpython_script_12 = GhPythonScript(vertices=deconstruct_mesh.Vertices, v_count=ghpython_script_8.m2)  # -> out, corner_nodes, point; inputs vertices: list
# ---------- ghpython_script_12: Python ----------
__author__ = "kuhnso"
__version__ = "2023.02.06"


import rhinoscriptsyntax as rs

    
corner_nodes=[]
for i in range(int(v_count+1)):
    corner_nodes.append(vertices[i])

# remove first point
corner_nodes = corner_nodes[1:]
# ---------- end ghpython_script_12 ----------
ghpython_script_13 = GhPythonScript(vertices=deconstruct_mesh_3.Vertices, v_count=ghpython_script_8.m1)  # -> out, corner_nodes, point; inputs vertices: list
# ---------- ghpython_script_13: Python ----------
__author__ = "kuhnso"
__version__ = "2023.02.06"



import rhinoscriptsyntax as rs


corner_nodes=[]
for i in range(int(v_count+1)):
    corner_nodes.append(vertices[i])
# ---------- end ghpython_script_13 ----------
ghpython_script_14 = GhPythonScript(vertices=deconstruct_mesh_2.Vertices, v_count=ghpython_script_8.m3)  # -> out, corner_nodes, point; inputs vertices: list
# ---------- ghpython_script_14: Python ----------
__author__ = "kuhnso"
__version__ = "2023.02.06"





corner_nodes=[]
for i in range(int(v_count+1)):
    corner_nodes.append(vertices[i])



# remove first point
corner_nodes = corner_nodes[1:]
# ---------- end ghpython_script_14 ----------
ghpython_script_15 = GhPythonScript(vertices=deconstruct_mesh_4.Vertices, u_count=ghpython_script_10.w1, v_count=ghpython_script_10.m1)  # -> out, support_nodes, point; inputs vertices: list
# ---------- ghpython_script_15: Python ----------
__author__ = "kuhnso"
__version__ = "2023.02.06"



import rhinoscriptsyntax as rs
    
#Define number of sections
nr_sec_l=3
nr_sec_h=3
nr_sec=nr_sec_l*nr_sec_h
    
#calculate indices
nr_nodes=int((u_count+1)*(v_count+1))#*6+(u_count)*4+(v_count)*4
print(nr_nodes)
    
support_nodes=[]
a=int((v_count+1)*u_count)
for i in range(a,nr_nodes):
    support_nodes.append(vertices[int(i)])
    #support_nodes.append(vertices[a:])
# ---------- end ghpython_script_15 ----------
ghpython_script_16 = GhPythonScript(vertices=deconstruct_mesh_5.Vertices, u_count=ghpython_script_10.w1, v_count=ghpython_script_10.m2)  # -> out, support_nodes, point; inputs vertices: list
# ---------- ghpython_script_16: Python ----------
__author__ = "kuhnso"
__version__ = "2023.02.06"

import rhinoscriptsyntax as rs

#Define number of sections
nr_sec_l=3
nr_sec_h=3
nr_sec=nr_sec_l*nr_sec_h

#calculate indices
nr_nodes=int((u_count+1)*(v_count+1))#*6+(u_count)*4+(v_count)*4
print(nr_nodes)

support_nodes=[]
a=int((v_count+1)*u_count)
for i in range(a,nr_nodes):
    support_nodes.append(vertices[int(i)])
#support_nodes.append(vertices[a:])
    
    
    
# remove first point
support_nodes = support_nodes[1:]
# ---------- end ghpython_script_16 ----------
ghpython_script_17 = GhPythonScript(vertices=deconstruct_mesh_6.Vertices, u_count=ghpython_script_10.w1, v_count=ghpython_script_10.m3)  # -> out, support_nodes, point; inputs vertices: list
# ---------- ghpython_script_17: Python ----------
__author__ = "kuhnso"
__version__ = "2023.02.06"


import rhinoscriptsyntax as rs

#Define number of sections
nr_sec_l=3
nr_sec_h=3
nr_sec=nr_sec_l*nr_sec_h

#calculate indices
nr_nodes=int((u_count+1)*(v_count+1))#*6+(u_count)*4+(v_count)*4
print(nr_nodes)

support_nodes=[]
a=int((v_count+1)*u_count)
for i in range(a,nr_nodes):
    support_nodes.append(vertices[int(i)])
#support_nodes.append(vertices[a:])
    
    
    
# remove first point
support_nodes = support_nodes[1:]
# ---------- end ghpython_script_17 ----------
mpc_points_wall_2 = Point(ghpython_script_12.corner_nodes)
mpc_points_wall_1 = Point(ghpython_script_13.corner_nodes)
mpc_points_wall_3 = Point(ghpython_script_14.corner_nodes)
mpc_points_wall_1_1 = Point(ghpython_script_15.support_nodes)
mpc_points_wall_1_2 = Point(ghpython_script_16.support_nodes)
mpc_points_wall_1_3 = Point(ghpython_script_17.support_nodes)
list_item = ListItem(List=deconstruct_mesh_4.Vertices, Index=Slider(197, range=0..200), Wrap=True)
vector_xyz_2 = VectorXYZ(XComponent=0, YComponent=ghpython_script_3.L_el, ZComponent=0)  # -> Vector, Length
merge_2 = Merge(Data1=mpc_points_wall_1, Data2=mpc_points_wall_2, Data3=mpc_points_wall_3)
vector_xyz_3 = VectorXYZ(XComponent=0, YComponent=ghpython_script_3.L_el, ZComponent=0)  # -> Vector, Length
merge_3 = Merge(Data1=mpc_points_wall_1_1, Data2=mpc_points_wall_1_2, Data3=mpc_points_wall_1_3)
move_2 = Move(Geometry=merge_2, Motion=vector_xyz_2.Vector)  # -> Geometry, Transform
move_3 = Move(Geometry=merge_3, Motion=vector_xyz_3.Vector)  # -> Geometry, Transform
mpc_nodes_wall2 = Point(move_2.Geometry)
mpc_nodes_wall2_2 = Point(move_3.Geometry)
merge_4 = Merge(Data1=mpc_points_wall_1, Data2=mpc_points_wall_2, Data3=mpc_points_wall_3, Data4=mpc_nodes_wall2)
merge_5 = Merge(Data1=mpc_points_wall_1_1, Data2=mpc_points_wall_1_2, Data3=mpc_points_wall_1_3, Data4=mpc_nodes_wall2_2)
ghpython_script_18 = GhPythonScript(wall_corner_points=merge_5, plate_corner_points=merge_4)  # -> out, mpc_elements; inputs wall_corner_points: list of Point3d, plate_corner_points: list of Point3d
# ---------- ghpython_script_18: Python ----------
__author__ = "kuhnso"
__version__ = "2023.02.20"


import rhinoscriptsyntax as rs
mpc_elements=[]
for i,j in zip(wall_corner_points,plate_corner_points):
    print(i,j)
    mpc_elements.append(rs.AddLine(i, j))
# ---------- end ghpython_script_18 ----------

# ----
# Support Points Extraction
# Wall1
# Wall2
ghpython_script_19 = GhPythonScript(
    mesh_counts_plate=ghpython_script_3.mesh_counts_plate,
    mesh_counts_walls=wall1_generation_withrigidlinks.mesh_counts_walls)  # -> m1, m2, m3, p1, p3, w1, w2, w3; inputs mesh_counts_plate: list, mesh_counts_walls: list; same code as ghpython_script_6
ghpython_script_20 = GhPythonScript(wall_1_meshes=wall_1_10)  # -> wall_1, wall_2, wall_3, wall_4, wall_5, wall_6, wall_7, wall_8, wall_9; inputs wall_1_meshes: list; same code as ghpython_script_11
wall_1_8_2 = Geometry(ghpython_script_20.wall_8)
wall_1_9_2 = Geometry(ghpython_script_20.wall_9)
wall_1_7_2 = Geometry(ghpython_script_20.wall_7)
deconstruct_mesh_7 = DeconstructMesh(Mesh=wall_1_7_2)  # -> flatten(Vertices), Faces, Colours, Normals
deconstruct_mesh_8 = DeconstructMesh(Mesh=wall_1_8_2)  # -> flatten(Vertices), Faces, Colours, Normals
deconstruct_mesh_9 = DeconstructMesh(Mesh=wall_1_9_2)  # -> flatten(Vertices), Faces, Colours, Normals
ghpython_script_21 = GhPythonScript(vertices=deconstruct_mesh_7.Vertices, u_count=w3, v_count=ghpython_script_19.m1)  # -> out, support_nodes, point; inputs vertices: list
# ---------- ghpython_script_21: Python ----------
__author__ = "kuhnso"
__version__ = "2023.02.06"

import rhinoscriptsyntax as rs

#Define number of sections
nr_sec_l=3
nr_sec_h=3
nr_sec=nr_sec_l*nr_sec_h

#calculate indices
nr_nodes=(u_count+1)*(v_count+1)#*6+(u_count)*4+(v_count)*4
print(nr_nodes)

support_nodes=[]
for j in [0]:
   node1=int(j*nr_nodes)
   for i in range(int(v_count+1)):
        support_nodes.append(vertices[int(node1+i)])
# ---------- end ghpython_script_21 ----------
ghpython_script_22 = GhPythonScript(vertices=deconstruct_mesh_8.Vertices, u_count=w3, v_count=ghpython_script_19.m2)  # -> out, support_nodes, point; inputs vertices: list
# ---------- ghpython_script_22: Python ----------
__author__ = "kuhnso"
__version__ = "2023.02.06"

import rhinoscriptsyntax as rs

#Define number of sections
nr_sec_l=3
nr_sec_h=3
nr_sec=nr_sec_l*nr_sec_h

#calculate indices
nr_nodes=(u_count+1)*(v_count+1)#*6+(u_count)*4+(v_count)*4
print(nr_nodes)

support_nodes=[]
for j in [0]:
   node1=int(j*nr_nodes)
   for i in range(int(v_count+1)):
        support_nodes.append(vertices[int(node1+i)])
        
        
# remove first point
support_nodes = support_nodes[1:]
# ---------- end ghpython_script_22 ----------
ghpython_script_23 = GhPythonScript(vertices=deconstruct_mesh_9.Vertices, u_count=w3, v_count=ghpython_script_19.m3)  # -> out, support_nodes, point; inputs vertices: list
# ---------- ghpython_script_23: Python ----------
__author__ = "kuhnso"
__version__ = "2023.02.06"

import rhinoscriptsyntax as rs

#Define number of sections
nr_sec_l=3
nr_sec_h=3
nr_sec=nr_sec_l*nr_sec_h

#calculate indices
nr_nodes=(u_count+1)*(v_count+1)#*6+(u_count)*4+(v_count)*4
print(nr_nodes)

support_nodes=[]
for j in [0]:
   node1=int(j*nr_nodes)
   for i in range(int(v_count+1)):
        support_nodes.append(vertices[int(node1+i)])
        
        
        
# remove first point
support_nodes = support_nodes[1:]
# ---------- end ghpython_script_23 ----------
support_nodes_wall1_7 = Point(ghpython_script_21.support_nodes)
support_nodes_wall1_8 = Point(ghpython_script_22.support_nodes)
support_nodes_wall1_9 = Point(ghpython_script_23.support_nodes)
# This component group extracts the support points form both wall 1 and wall 2.
support_nodes_wall1 = Point([support_nodes_wall1_7, support_nodes_wall1_8, support_nodes_wall1_9])
vector_xyz_4 = VectorXYZ(XComponent=0, YComponent=ghpython_script_3.L_el, ZComponent=0)  # -> Vector, Length
move_4 = Move(Geometry=support_nodes_wall1, Motion=vector_xyz_4.Vector)  # -> Geometry, Transform
# This component group extracts the end points for the MPC (stiff) elements and then connects creates the MPC elements.
# The MPCs are the elements that connect the deck slab with the walls. And then
support_nodes_wall2 = Point(move_4.Geometry)

# ----
# Layers and Property Table Generation
save_in_layers = BooleanToggle(True)
support_nodes_wall2_2 = Point(support_nodes_wall2)
support_nodes_wall1_2 = Point(support_nodes_wall1)
# This component creates layers and adds the corresponding elements to these layers.
plate_10 = Geometry(plate)
wall_1_11 = Geometry(wall_1)
wall_2_3 = Geometry(wall_2_2)
layer_creator = GhPythonScript(
    save_in_layers=save_in_layers,
    wall1=wall_1_11,
    wall2=wall_2_3,
    plate=plate_10,
    support_nodes_wall1=support_nodes_wall1_2,
    support_nodes_wall2=support_nodes_wall2_2,
    mpc_elements=ghpython_script_18.mpc_elements)  # -> layer_names, layerNames; inputs wall1: list of Mesh, wall2: list of Mesh, plate: list of Mesh, support_nodes_wall1: list of Point3d, support_nodes_wall2: list of Point3d, mpc_elements: list of Line
# ---------- layer_creator: Python ----------
__author__ = "kuhnso"
__version__ = "2023.02.06"


import Rhino as r
import rhinoscriptsyntax as rs
import scriptcontext as sc
import System.Drawing.Color as col






# Create Layers and add the correspondin geometry 
if save_in_layers:
    
    
    
    #####################
    #initialize
    #####################

    
    layer_names=[]

    
    # Set active doc to the currently open Rhino file
    sc.doc = r.RhinoDoc.ActiveDoc
    
    # Delete all elements, meshes from previous iterations
    # (does not deleate the layers, just the geometry objects)
    rs.Command("_SelAll", True)
    rs.Command("_Delete",True)
    
    #set default layer to active layer
    Default= sc.doc.Layers.FindByFullPath("Default", 0)
    sc.doc.Layers.SetCurrentLayerIndex(Default, False)
    #deleate all layers (except Default wich is set to the active layer)
    #LayerPurge() deleats all layers no matter if they are filled with objects
    layerNames=rs.LayerNames()
    for layer in layerNames:
        rs.PurgeLayer(layer)
    
    
    
    #####################
    #create layers and add geometry
    #####################
    
    ##### Support points

    sc.doc.Layers.Add("nset_support_wall1", col.Gray)
    layer_path= sc.doc.Layers.FindByFullPath("nset_support_wall1", 0)
    # Add meshes and points to their respective layers
    sc.doc.Layers.SetCurrentLayerIndex(layer_path, False)
    for i in range(len(support_nodes_wall1)):
        sc.doc.Objects.AddPoint(support_nodes_wall1[i])

        
    sc.doc.Layers.Add("nset_support_wall2", col.Gray)
    layer_path= sc.doc.Layers.FindByFullPath("nset_support_wall2", 0)
    # Add meshes and points to their respective layers
    sc.doc.Layers.SetCurrentLayerIndex(layer_path, False)
    for i in range(len(support_nodes_wall2)):
        sc.doc.Objects.AddPoint(support_nodes_wall2[i])


    
    ##### Plate layers 
    
    
    for i in range(len(plate)):
        # add layer
        sc.doc.Layers.Add("elset_plate_{}".format(i+1), col.Orange)
        layer_path= sc.doc.Layers.FindByFullPath("elset_plate_{}".format(i+1), 0)
        # Add meshes and points to their respective layers
        sc.doc.Layers.SetCurrentLayerIndex(layer_path, False)
        sc.doc.Objects.AddMesh(plate[i])

    

    
    
    ##### Wall Layers
    ###### loop layer generation (number dependant on parameters)
    # wall 1
    for i in range(len(wall1)):
        # add layer
        sc.doc.Layers.Add("elset_wall_1_{}".format(i+1), col.Blue)
        layer_path= sc.doc.Layers.FindByFullPath("elset_wall_1_{}".format(i+1), 0)
        # Add meshes and points to their respective layers
        sc.doc.Layers.SetCurrentLayerIndex(layer_path, False)
        sc.doc.Objects.AddMesh(wall1[i])


    # wall 2
    for i in range(len(wall2)):
        # add layer
        sc.doc.Layers.Add("elset_wall_2_{}".format(i+1), col.Blue)
        layer_path= sc.doc.Layers.FindByFullPath("elset_wall_2_{}".format(i+1), 0)
        # Add meshes and points to their respective layers
        sc.doc.Layers.SetCurrentLayerIndex(layer_path, False)
        sc.doc.Objects.AddMesh(wall2[i])

        
      
        
        
    
    
    
    ##### MPCs
        
    # MPC elements layer
    sc.doc.Layers.Add("elset_mpcs", col.Pink)
    layer_path= sc.doc.Layers.FindByFullPath("elset_mpcs", 0)
    # Add lines to the layer
    sc.doc.Layers.SetCurrentLayerIndex(layer_path, False)
    for i in range(len(mpc_elements)):
        #print(mpc_elements[i])
        sc.doc.Objects.AddLine(mpc_elements[i])




    #####################
    # post preparations
    #####################
   
        
    #set Default layer to active layer again
    Default= sc.doc.Layers.FindByFullPath("Default", 0)
    sc.doc.Layers.SetCurrentLayerIndex(Default, False)
    
    
    #remove all empty layers (except Default layer, as this is the active layer)
    #DeleteLayers() deleats only the empty layers (if there are any)
    layerNames=rs.LayerNames()
    for layer in layerNames:
        rs.DeleteLayer(layer)
        
        
        
    # get the layer names of all currently existing layers 
    # first layer is the default layer so only take 1 to the end
    layerNames=rs.LayerNames()[1:]
# ---------- end layer_creator ----------
write = BooleanToggle(True)
id = Number(delete_save_ut_error.idx)
t_w_2 = Number(t_w)
l_el = Number(ghpython_script_3.L_el)
h_fp = Number(t_p)
h_w_m = Number(h_w)
# This component writes variables in the document user text.
property_table_creator = GhPythonScript(write=write, id=id, layer_names=layer_creator.layerNames, L_el=l_el, h_FP=h_fp, t_w=t_w_2, h_w_m=h_w_m)  # -> out, id, DocUserText; inputs id: Int32, layer_names: list
# ---------- property_table_creator: Python ----------
__author__ = "kuhnso"
__version__ = "2023.02.20"

import rhinoscriptsyntax as rs
import Rhino as r
import scriptcontext as sc

# Set active doc to the currently open Rhino file
sc.doc = r.RhinoDoc.ActiveDoc

if write:

    def mixed_list_to_string(mixed_list):
        # Convert each element in the list to a string
        string_list = [str(x) for x in mixed_list]
        # Join the string list using a comma separator
        result_string = ','.join(string_list)
        return result_string

# -------------------------------------------------------------------------------
#----------- Dave Dependent calculated parameters to User Text ------------------
#--------------------------------------------------------------------------------

# MOVED!
#    ## Clear rhino user text (all keys that we dont need)
#    if rs.GetDocumentUserText()== None:
#        print("Document User Text is already empty. No keys exist.")
#    else:
#        for key in rs.GetDocumentUserText():
#            rs.SetDocumentUserText(key,"") #To deleate the key it is addigned an empty value! then this key doesn show up anymore
#            print("All keys of DocumentUserText were deleated.")

# MOVED
#    ############# bridge index ######################
#    # is used identifier of this parameter combination
#    #save in Document User Text dict
#    rs.SetDocumentUserText("id",str(id))
    
    ############## layer name list #################
    loc_str=mixed_list_to_string(layer_names)
    rs.SetDocumentUserText("layer_names",loc_str)
    
    
    ############### Dependent calculated parameters ############
    #Wall Height and Span combined
    rs.SetDocumentUserText('h_w_m',str(h_w_m))
    rs.SetDocumentUserText('L_el',str(L_el))
    
#    ############## Supports ###################
#    #filter out layers that belong to this layer group
#    group_str="nset_support"
#    layer_names_support = [l for l in layer_names if group_str in l]
#    print(layer_names_support)
#    #define GH internal parameter
#    loc_list= []
#    #append features that are not used in GH
#    # TODO: if all parameter are sent through the GH file they have to be added in these commented lines
#    #loc_list.extend(features_supports)
#    #iterate through all layer names of this gorup an add properties
#    for l in layer_names_support:
#        loc_str=mixed_list_to_string(loc_list)
#        rs.SetDocumentUserText(l,loc_str)
        
        
#    ############# MPCs ##############
#    if withMPCs:
#        rs.SetDocumentUserText("elset_mpcs",str(None))
    
    ################## Plate (elements without voute) #############
    #filter out layers that belong to this layer group
    group_str='elset_plate'
    layer_names_plate = [l for l in layer_names if group_str in l]
    exclude_str='_v_'
    layer_names_plate = [l for l in layer_names_plate if exclude_str not in l]
    #initialise list
    loc_list= []
    #define GH internal parameter that are the same for all of the group layers
    loc_list.extend([h_FP])
    #append features that are not used in GH
    #loc_list.extend(features_plate)
    #iterate through all layer names of this gorup an add properties
    for l in layer_names_plate:
        loc_str=mixed_list_to_string(loc_list)
        rs.SetDocumentUserText(l,loc_str)
    
    
    


    
    ######## Wall layers ########
    group_str="elset_wall"
    layer_names_walls = [l for l in layer_names if group_str in l]
    #initialise list
    loc_list= []
    #define GH internal parameter that are the same for all of the group layers
    loc_list.extend([t_w])
    #append features that are not used in GH
    #loc_list.extend(features_walls)
    #iterate through all layer names of this gorup an add properties
    for l in layer_names_walls:
        loc_str=mixed_list_to_string(loc_list)
        rs.SetDocumentUserText(l,loc_str)
    
    
    
    
    
    DocUserText=rs.GetDocumentUserText()
    
    # writing id output --> to trigger next box (save and delete)
    # Attention! this has to be done as very last step!
    id=id
    
    
    
    
    
    
    
    
    ###  ___________________________________________
    
    ### TODO include these extra parameters
    #fck=30
    #fsd=435
    #
    #
    #prop_table=[]
    #
    ## seperate layer names into element groups
    #layer_names_support=layer_names[0:2]
    #
    ##TODO: problem: we now have different number of elset_plate layers depending on case
    ## TODO: parapet layers are now also more than before and at different position
    ## TODO: solution: identify all layer names that belong to one group
    #layer_names_plate_wo_v=layer_names[2:11]
    #layer_names_walls=layer_names[11:29]
    #layer_names_parapet=layer_names[29]
    #if withMPCs:
    #    layer_names_mpcs=layer_names[30]
    #    if case >0:
    #        layer_names_plate_v=layer_names[31:]
    #else:
    #    if case >0:
    #        layer_names_plate_v=layer_names[30:]
    #        
    #
    #
    #
    ##support point layers
    #for i in layer_names_support:
    #    #print(i)
    #    layer_prop=[i,None]
    #    prop_table.append(layer_prop)
    #    
    ##plate layers (elements without voute)
    #for i in layer_names_plate_wo_v:
    #    #print(i)
    #    layer_prop=[i,h_FP]
    #    prop_table.append(layer_prop)
    #
    ##wall layers
    #for i in layer_names_walls:
    #    print(i)
    #    print(t_w)
    #    rs.SetDocumentUserText(i,str(t_w)+','+str(fck))
    #    layer_prop=[i,t_w]
    #    prop_table.append(layer_prop)
    #    #print(layer_prop)
    #
    ##parapet layer
    #layer_prop=[layer_names_parapet,h_b]
    #prop_table.append(layer_prop)
    #
    #if withMPCs:
    #    #mpcs layer
    #    layer_prop=[layer_names_mpcs,None]
    #    prop_table.append(layer_prop)
    #
    ##plate layers (elements WITH voute) of variable number
    #if case > 0:
    #    m_o=6 # as we have 6 outer plate sections
    #    for j in range(m_o):
    #        for n,i in enumerate(layer_names_plate_v[int(j*n_v_out):int((j+1)*n_v_out)]):
    #            layer_prop=[i,t_list_1[n]]
    #            prop_table.append(layer_prop)
    #            
    #    if case == 2:
    #        #m_i=3 # as we have 3 inner plate sections but on both sides
    #        index=m_o*n_v_out
    #        for j in range(m_o): # as we have 3 inner plate sections on each side
    #            for n,i in enumerate(layer_names_plate_v[index+n_v_in*j:index+n_v_in*(j+1)]):
    #                layer_prop=[i,t_list_3[n]]
    #                prop_table.append(layer_prop)
    #        
    #            
            
            
    #for i in layer_names_plate_v:
    #    #print(i)
    #    layer_prop=[i,h_FP]
    #    prop_table.append(layer_prop)
    
    # iterate through layer names
    # create lists for each layer with properties
    #for i in layer_names:
    #    #print(i)
    #    layer_prop=[i,h_FP]
    #    prop_table.append(layer_prop)
    #
# ---------- end property_table_creator ----------

idx_s_2 = Integer(ghpython_script_2.idx_s)

# ----
# Save .3dm files
boolean_toggle = BooleanToggle(True)
# This comonent saves the individual bridges in .3dm fils under batch folder path.
path_2 = Text(ghpython_script.batch_folder_path)
ghpython_script_24 = GhPythonScript(write=boolean_toggle, idx_s=idx_s_2, idx_c=property_table_creator.id, folderPath=path_2)  # -> out, idx_c
# ---------- ghpython_script_24: Python ----------
__author__ = "Kuhnso"
__version__ = "2023.07.14"

import rhinoscriptsyntax as rs
import scriptcontext as sc
import Rhino as r
import os
import System.Drawing.Color as col



if write:
    
    print(folderPath)
    subFolderPath= folderPath + '\\{}_{}_CFB'.format(int(idx_s),int(idx_c))
    
    # Check if the folder exists
    if not os.path.exists(subFolderPath):
        # Create the folder
        os.makedirs(subFolderPath)
    
    filePath=subFolderPath+'\\geo.3dm'  #'\\{}_{}_geo.3dm'.format(int(idx_s),int(idx_c))
    
    opt = r.FileIO.FileWriteOptions()
    doc = r.RhinoDoc.ActiveDoc
    doc.WriteFile(filePath,opt) #note: also saves DocUserText
# ---------- end ghpython_script_24 ----------

loop_end = LoopEnd(
    port=loop_start.port,
    Exit=False,
    Data=ghpython_script_24.idx_c,
    TimeOutVal=0,
    pausedState=False,
    state="Constant & Record")  # -> flatten(Data)

# ----
# Records the index of the bridges it has already calculates
panel_4 = Panel(loop_end)
